# Grasshopper definition rungh_lpt.gh (Grasshopper 0.9.76)
# plug-ins: Python Interpreter

honeybee = Honeybee_Honeybee()  # -> Vviiiiiiiiiizzz; plug-in component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
ladybug = Ladybug_Ladybug()  # -> Vviiiiiiiiiizzz; plug-in component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
panel = Panel(honeybee)
brep = Brep([<brep referenced from the Rhino model> x3])
energysimpar = Honeybee_EnergySimulationPar(timestep=6, heatingSizingFactor="1.2", coolingSizingFactor="1.2", terrain="1")  # -> energySimPar; plug-in component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
mass2zone = Honeybee_Masses2Zones(zoneMasses=flatten(brep), isConditioned=True, maxRoofAngle=30, createHBZones=Toggle(True))  # -> readMe, HBZones; plug-in component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
epoutput = Honeybee_GenerateEPOutput(zoneEnergyUse=Toggle(True), zoneGainsAndLosses="False", zoneComfortMetrics="False", surfaceTempAnalysis="False")  # -> report, flatten(simulationOutputs); plug-in component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
analysisperiod = Ladybug_AnalysisPeriod(toMonth="6")  # -> readMe, analysisPeriod; plug-in component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
panel_2 = Panel(mass2zone.HBZones)
pt = Point(Point(14, 16, 0))
panel_3 = Panel(mass2zone.readMe)
panel_4 = Panel(epoutput.report)
vec = Vector(Vector(0, 98, 0))
open_weather_file = Ladybug_OpenEPWWeatherFile(open=Toggle(True))  # -> epwFile; plug-in component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
vdis = VectorDisplay(Anchor=pt, Vector=vec)
runenergysimulation = Honeybee_RunEnergySimulation(
    north=vec,
    epwFile=open_weather_file,
    analysisPeriod=analysisperiod.analysisPeriod,
    energySimPar=energysimpar,
    HBZones=flatten(mass2zone.HBZones),
    simulationOutputs=flatten(epoutput.simulationOutputs),
    writeIdf=Toggle(True),
    runEnergyPlus=Toggle(True),
    workingDir="C:\Users\celsloaner\Desktop\lpt\rungh",
    idfFileName="lpt1run")  # -> report, idfFileAddress, resultFileAddress; plug-in component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
panel_5 = Panel(runenergysimulation.report)
readepresult = Honeybee_ReadEPResult(resultFileAddress=runenergysimulation.resultFileAddress)  # -> totalThermalLoad, thermalLoadBalance, cooling, heating, electricLight, electricEquip, port, port_2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; plug-in component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
_3dchart = Ladybug_3DChart(inputData=flatten(readepresult.totalThermalLoad))  # -> readMe, graphMesh, graphCurves, legend, legendBasePts, title, titleBasePts, dataPts, conditionalHOY; plug-in component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
